# Grasshopper definition latent_space.gh (Grasshopper 1.0.7)
# plug-ins: Human, GH_CPython, SonicMat

panel = Panel()

# ---- group: Set CSV Path
latent_codes_csv_full_path = Panel("C:\Users\deepa\Downloads\Latent_codes_carnival.csv")

# ---- group: Set Image Paths
num_of_images = Panel("36")
image_directories = GH_CPython(input=num_of_images)  # -> simplify(output); inputs input: list
#   port input: [required] - [type = int] - [default = None] Descripe your input here * bullet point. * bullet point
#   port output: indicate your output description here. refers to a new line.
# ---------- image_directories: Python ----------
import os

# set image folder ----------------

_rootfolder = 'G:\\My Drive\\images\\latent_space_sm\\' 

#----------------------------------

# list out all the contents in the folder (no need to modify)
dirs = os.listdir(_rootfolder)

output_ = []
for dir in dirs:
    output_.append(_rootfolder + dir)

print(output_)
# ---------- end image_directories ----------

# ----
equality = Equality(FirstNumber=panel, SecondNumber="europe")  # -> Equality, Inequality
ghpython_script = GhPythonScript()  # -> Out, A
cull_pattern = CullPattern(List=panel, CullPattern=equality.Equality)
file = ReadFile(File=latent_codes_csv_full_path, PerLineParse=True)
length = Length()
panel_2 = Panel()
python = GhPythonScript(x=file)  # -> out, a
# ---------- python: Python ----------
__author__ = "willi"
__version__ = "2023.03.03"

import rhinoscriptsyntax as rs

a = x.split(',')
# ---------- end python ----------
panel_3 = Panel(image_directories)
smaller_than = SmallerThan(FirstNumber=length, SecondNumber=Slider(1000, range=0..1000))  # -> SmallerThan, OrEqualTo
panel_4 = Panel(python.a)
line = Line(StartPoint=panel_2, EndPoint=graft(panel_2))
cull_pattern_2 = CullPattern(CullPattern=smaller_than.OrEqualTo)
graft_tree = GraftTree(IncludeEmptyLists=True, IncludeNullItems=True)
custom_preview = CustomPreview(Geometry=line, Material=ColourSwatch(SwatchColor=RGB(255, 255, 255)))
line_2 = Line(StartPoint=graft_tree)
split = TextSplit(Text=panel_3, Separators="'")  # -> simplify(Result)
item = ListItem(List=panel_4, Index="0", Wrap=True)
item_2 = ListItem(List=panel_4, Index="1", Wrap=True)
item_3 = ListItem(List=panel_4, Index="2", Wrap=True)
panel_5 = Panel(split)
panel_6 = Panel(item_3)
panel_7 = Panel(item_2)
panel_8 = Panel(item)
custom_preview_lineweights = CustomPreviewLineweights(Geometry=line_2, Shader=line_2, Absolute=False)
num = Number(simplify(panel_8))
num_2 = Number(simplify(panel_7))
num_3 = Number(simplify(panel_6))
item_4 = ListItem(List=panel_5, Index="1", Wrap=True)  # -> flatten(Item)
panel_9 = Panel(item_4)

# ---- group: Nodes (Image Surfaces)
pt = ConstructPoint(XCoordinate=num, YCoordinate=num_2, ZCoordinate=num_3)  # -> flatten(Point)
number_slider = Slider(10, range=0..100)
geo = Geometry(pt)
box = CenterBox(Base=geo, X=number_slider, Y=number_slider, Z="0")
mat = Material(Surface=box, String=panel_9, Double=Slider(0, range=0..100))

# ----
swatch = ColourSwatch(SwatchColor=RGB(194, 194, 194))

# ---- group: Image Captions
join = TextJoin(Text=[panel_8, panel_7, panel_6], Join=", ")  # -> simplify(Result); disabled
boxprop = BoxProperties(Box=box)  # -> Center, Diagonal, Area, Volume, Degeneracy; disabled
X = UnitX(Factor=Slider(22, range=0..100))
move = Move(Geometry=boxprop.Center, Motion=X)  # -> Geometry, Transform
panel_10 = Panel(join)
tag = TextTag3D(Location=move.Geometry, Text=flatten(panel_10), Size=1, Colour=swatch, Justification=7)

# ---- group: Edges
crossref = CrossReference(ListA=boxprop.Center, ListB=boxprop.Center, CrossMode=1)  # -> ListA, ListB
ln = Line(StartPoint=crossref.ListA, EndPoint=crossref.ListB)
preview = CustomPreview(Geometry=ln, Material=swatch)
lt_table = LinetypeTable(Update=Toggle(True))  # -> Linetypes, LinetypePattern
panel_11 = Panel(lt_table.Linetypes)
item_5 = ListItem(List=flatten(lt_table.Linetypes), Index=Slider(1, range=0..5), Wrap=True)
panel_12 = Panel(item_5)
geo_2 = Geometry(ln)
createatts = CreateAttributes(LinetypeName=panel_12, PlotColor=swatch, enableFullPath=False)
previewlw = CustomPreviewLineweights(Geometry=geo_2, Shader=swatch, Thickness=Slider(1, range=0..5), Absolute=Toggle(False))
bake = BakeGeometry(Bake=Button(), Geometry=geo_2, Attributes=createatts, DeleteOldBakes=False, PreserveTrees=False)

# ----
X_2 = UnitX(Factor=Slider(11, range=0..100))
move_2 = Move(Geometry=boxprop.Center, Motion=X_2)  # -> Geometry, Transform
partition = PartitionList(List=move_2.Geometry, Size="6")  # -> simplify(Chunks)
panel_13 = Panel(partition)
swatch_2 = ColourSwatch(SwatchColor=RGB(234, 38, 0))
swatch_3 = ColourSwatch(SwatchColor=RGB(234, 64, 0))
swatch_4 = ColourSwatch(SwatchColor=RGB(234, 128, 2))
swatch_5 = ColourSwatch(SwatchColor=RGB(243, 177, 36))
swatch_6 = ColourSwatch(SwatchColor=RGB(252, 235, 77))
swatch_7 = ColourSwatch(SwatchColor=RGB(248, 241, 97))
swatch_8 = ColourSwatch(SwatchColor=RGB(208, 221, 178))
swatch_9 = ColourSwatch(SwatchColor=RGB(175, 204, 246))
swatch_10 = ColourSwatch(SwatchColor=RGB(156, 186, 235))
swatch_11 = ColourSwatch(SwatchColor=RGB(104, 135, 192))
swatch_12 = ColourSwatch(SwatchColor=RGB(234, 111, 0))

# ---- group: Draw Image Frames by Clusters
subset = SubList(List=box, Domain="0 to 5", Wrap=True)  # -> List, Index
subset_2 = SubList(List=box, Domain="6 to 11", Wrap=True)  # -> List, Index
subset_3 = SubList(List=box, Domain="12 to 17", Wrap=True)  # -> List, Index
subset_4 = SubList(List=box, Domain="18 to 23", Wrap=True)  # -> List, Index
subset_5 = SubList(List=box, Domain="24 to 29", Wrap=True)  # -> List, Index
subset_6 = SubList(List=box, Domain="30 to 35", Wrap=True)  # -> List, Index
subset_7 = SubList(List=box, Domain="36 to 41", Wrap=True)  # -> List, Index
subset_8 = SubList(List=box, Domain="42 to 47", Wrap=True)  # -> List, Index
subset_9 = SubList(List=box, Domain="48 to 53", Wrap=True)  # -> List, Index
subset_10 = SubList(List=box, Domain="54 to 59", Wrap=True)  # -> List, Index
subset_11 = SubList(List=box, Domain="60 to 65", Wrap=True)  # -> List, Index
frame_width = Slider(2, range=0..5)
edges = BrepEdges(Brep=subset.List)  # -> Naked, Interior, NonManifold
edges_2 = BrepEdges(Brep=subset_2.List)  # -> Naked, Interior, NonManifold
edges_3 = BrepEdges(Brep=subset_3.List)  # -> Naked, Interior, NonManifold
edges_4 = BrepEdges(Brep=subset_4.List)  # -> Naked, Interior, NonManifold
edges_5 = BrepEdges(Brep=subset_5.List)  # -> Naked, Interior, NonManifold
edges_6 = BrepEdges(Brep=subset_6.List)  # -> Naked, Interior, NonManifold
edges_7 = BrepEdges(Brep=subset_7.List)  # -> Naked, Interior, NonManifold
edges_8 = BrepEdges(Brep=subset_8.List)  # -> Naked, Interior, NonManifold
edges_9 = BrepEdges(Brep=subset_9.List)  # -> Naked, Interior, NonManifold
edges_10 = BrepEdges(Brep=subset_10.List)  # -> Naked, Interior, NonManifold
edges_11 = BrepEdges(Brep=subset_11.List)  # -> Naked, Interior, NonManifold
previewlw_2 = CustomPreviewLineweights(Geometry=edges.Naked, Shader=swatch_2, Thickness=frame_width, Absolute=False)
previewlw_3 = CustomPreviewLineweights(Geometry=edges_2.Naked, Shader=swatch_3, Thickness=frame_width, Absolute=False)
previewlw_4 = CustomPreviewLineweights(Geometry=edges_3.Naked, Shader=swatch_12, Thickness=frame_width, Absolute=False)
previewlw_5 = CustomPreviewLineweights(Geometry=edges_4.Naked, Shader=swatch_4, Thickness=frame_width, Absolute=False)
previewlw_6 = CustomPreviewLineweights(Geometry=edges_5.Naked, Shader=swatch_5, Thickness=frame_width, Absolute=False)
previewlw_7 = CustomPreviewLineweights(Geometry=edges_6.Naked, Shader=swatch_6, Thickness=frame_width, Absolute=False)
previewlw_8 = CustomPreviewLineweights(Geometry=edges_7.Naked, Shader=swatch_7, Thickness=frame_width, Absolute=False)
previewlw_9 = CustomPreviewLineweights(Geometry=edges_8.Naked, Shader=swatch_8, Thickness=frame_width, Absolute=False)
previewlw_10 = CustomPreviewLineweights(Geometry=edges_9.Naked, Shader=swatch_9, Thickness=frame_width, Absolute=False)
previewlw_11 = CustomPreviewLineweights(Geometry=edges_10.Naked, Shader=swatch_10, Thickness=frame_width, Absolute=False)
previewlw_12 = CustomPreviewLineweights(Geometry=edges_11.Naked, Shader=swatch_11, Thickness=frame_width, Absolute=False)

# ---- group: Draw Image Frames
edges_12 = BrepEdges(Brep=box)  # -> Naked, Interior, NonManifold
previewlw_13 = CustomPreviewLineweights(Geometry=edges_12.Naked, Shader=ColourSwatch(SwatchColor=RGB(0, 0, 0)), Thickness=frame_width, Absolute=False)

# ----
bang = ExplodeTree(Data=panel_13)  # -> Branch0, Branch1, Branch2, Branch3, Branch4, Branch5, Branch6, Branch7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

# ---- group: Print Labels
number_slider_2 = Slider(2, range=0..20)
tag_2 = TextTag3D(Location=bang.Branch0, Text="0/100", Size=number_slider_2, Colour=swatch_2, Justification=7)
tag_3 = TextTag3D(Location=bang.Branch1, Text="10/90", Size=number_slider_2, Colour=swatch_3, Justification=7)
tag_4 = TextTag3D(Location=bang.Branch2, Text="20/80", Size=number_slider_2, Colour=swatch_12, Justification=7)
tag_5 = TextTag3D(Location=bang.Branch3, Text="30/70", Size=number_slider_2, Colour=swatch_4, Justification=7)
tag_6 = TextTag3D(Location=bang.Branch4, Text="40/60", Size=number_slider_2, Colour=swatch_5, Justification=7)
tag_7 = TextTag3D(Location=bang.Branch5, Text="50/50", Size=number_slider_2, Colour=swatch_6, Justification=7)
tag_8 = TextTag3D(Location=bang.Branch6, Text="60/40", Size=number_slider_2, Colour=swatch_7, Justification=7)
tag_9 = TextTag3D(Location=bang.Branch7, Text="70/30", Size=number_slider_2, Colour=swatch_8, Justification=7)
tag_10 = TextTag3D(Location=bang.Branch8, Text="80/20", Size=number_slider_2, Colour=swatch_9, Justification=7)
tag_11 = TextTag3D(Location=bang.Branch9, Text="90/10", Size=number_slider_2, Colour=swatch_10, Justification=7)
tag_12 = TextTag3D(Location=bang.Branch10, Text="100/0", Size=number_slider_2, Colour=swatch_11, Justification=7)
